# Grasshopper definition installer.ghx (Grasshopper 1.0.8)

panel = Panel("C:\Users\gzorzeto\OneDrive - ETH Zurich\Desktop\dewbee_compos_target")
panel_2 = Panel("C:\Users\gzorzeto\Documents\GitHub_repos\dewbee_main\grasshopper\user_objects")
lbinstall = LBInstaller()  # -> Vviiiiiz; plug-in component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

# ---- group: Dewbee installer
lbinstall_2 = LBInstaller(dir_source=panel_2, dir_target=panel)  # -> out, a
# ---------- lbinstall_2: Python ----------
import os
import io
import subprocess
import System.Net
import System.Windows.Forms
import zipfile
import shutil
from distutils import dir_util
import Rhino
from Rhino.RhinoApp import Version as RHINO_VERSION
from Grasshopper.Folders import UserObjectFolders, DefaultAssemblyFolder
from Grasshopper.Kernel import GH_RuntimeMessageLevel as Message

CUSTOM_ENV = os.environ.copy()
CUSTOM_ENV['PYTHONHOME'] = ''


def turn_off_old_tag(component):
    """Turn off the old tag that displays on GHPython components.

    Args:
        component: The grasshopper component object, which can be accessed through
            the ghenv.Component call within Grasshopper API.
    """
    try:  # try to turn off the OLD tag on the component
        component.ToggleObsolete(False)
    except Exception:
        pass  # older version of Rhino that does not have the Obsolete method


def preparedir(target_dir, remove_content=True):
    """Prepare a folder for files to be written into it.

    This function creates the folder if it does not exist and removes the files in
    the folder if the folder already exists.

    This function has been copied from ladybug.futil.
    """
    if os.path.isdir(target_dir):
        if remove_content:
            nukedir(target_dir, False)
        return True
    else:
        try:
            os.makedirs(target_dir)
            return True
        except Exception as e:
            print("Failed to create folder: %s\n%s" % (target_dir, e))
            return False


def nukedir(target_dir, rmdir=False):
    """Delete all the files inside target_dir.

    This function has been copied from ladybug.futil.
    """
    d = os.path.normpath(target_dir)
    if not os.path.isdir(d):
        return

    files = os.listdir(d)
    for f in files:
        if f == '.' or f == '..':
            continue
        path = os.path.join(d, f)
        if os.path.isdir(path):
            nukedir(path)
        else:
            try:
                os.remove(path)
            except Exception:
                print("Failed to remove %s" % path)

    if rmdir:
        try:
            os.rmdir(d)
        except Exception:
            try:
                dir_util.remove_tree(d)
            except Exception:
                print("Failed to remove %s" % d)


def copy_file_tree(source_folder, dest_folder, overwrite=True):
    """Copy an entire file tree from a source_folder to a dest_folder.

    Args:
        source_folder: The source folder containing the files and folders to
            be copied.
        dest_folder: The destination folder into which all the files and folders
            of the source_folder will be copied.
        overwrite: Boolean to note whether an existing folder with the same
            name as the source_folder in the dest_folder directory should be
            overwritten. Default: True.
    """
    # make the dest_folder if it does not exist
    if not os.path.isdir(dest_folder):
        os.mkdir(dest_folder)

    # recursively copy each sub-folder and file
    for f in os.listdir(source_folder):
        # get the source and destination file paths
        src_file_path = os.path.join(source_folder, f)
        dst_file_path = os.path.join(dest_folder, f)

        # if overwrite is True, delete any existing files
        if overwrite:
            if os.path.isfile(dst_file_path):
                try:
                    os.remove(dst_file_path)
                except Exception:
                    raise IOError("Failed to remove %s" % f)
            elif os.path.isdir(dst_file_path):
                nukedir(dst_file_path, True)

        # copy the files and folders to their correct location
        if os.path.isfile(src_file_path):
            shutil.copyfile(src_file_path, dst_file_path)
        elif os.path.isdir(src_file_path):
            if not os.path.isdir(dst_file_path):
                os.mkdir(dst_file_path)
            copy_file_tree(src_file_path, dst_file_path, overwrite)

preparedir(dir_target)
copy_file_tree(dir_source, dir_target)
# ---------- end lbinstall_2 ----------

# ----
savecompos = __DBSaveCompos(run=Button())  # inputs run: Boolean
# ---------- savecompos: Python ----------
"""
Update the version of all ghuser objects available in Grasshopper\UserObjects\dewbee 
based on dewbee.__version__. Then, save them to the repository as .py and .ghuser, 
and update the local .ghuser files. Anything that has "DB" will be saved. 

This version:
. reads dewbee.__version__
. updates ghenv.Component.Message in component code
. cleans repo
. writes updated .py files
. writes updated .ghuser files by modifying the original user object
. updates .ghuser files in local directory (components shown in GH's tab)
-

    Args:
        _run: RUN IT BABY!
"""

import os
import Grasshopper.Kernel as ghK

ghenv.Component.Name = '__DB Save Compos'
ghenv.Component.NickName = 'SaveCompos'
ghenv.Component.Message = 'dev'
ghenv.Component.Category = 'Dewbee'
ghenv.Component.SubCategory = "0 :: Miscellaneous"

# Turn off the "old" tag
try:
    import ghpythonlib as ghlib
    c = ghlib.component._get_active_component()
    c.ToggleObsolete(False)
except Exception:
    pass

# Read Dewbee version
try:
    import dewbee
    reload(dewbee)
    DEWBEE_VERSION = dewbee.__version__
    ghenv.Component.Message = DEWBEE_VERSION
except Exception as e:
    raise ImportError("Failed to import dewbee.__version__:\n\t{}".format(e))

# Import ladybug dependencies
try:
    from ladybug.futil import preparedir, copy_file_tree
except Exception as e:
    raise ImportError("Failed to import dewbee.__version__:\n\t{}".format(e))

class NamespaceComponentsOntoCanvas(object):
    def __init__(self, namespace, source_dir, ghdoc):
        self.namespace = namespace
        self.source_dir = source_dir
        self.ghdoc = ghdoc
        self.compos = []

    def __enter__(self):
        print("Adding {} components to canvas...".format(self.namespace))

        for filename in os.listdir(self.source_dir):
            if filename.startswith('.'):
                continue
            if filename.startswith('__'):
                continue
            if not filename.endswith('.ghuser'):
                continue
            if not filename.startswith(self.namespace):
                continue

            source_path = os.path.join(self.source_dir, filename)
            uo = ghK.GH_UserObject(source_path)
            compo = uo.InstantiateObject()

            if compo is None:
                print("Failed to instantiate: {}".format(filename))
                continue

            self.ghdoc.AddObject(compo, False)
            self.compos.append((compo, uo, source_path))
            print("Added: {}".format(filename))

        return self

    def __exit__(self, exc_type, exc_val, exc_tb):
        print("Cleaning canvas...")
        for compo, _, _ in self.compos:
            self.ghdoc.RemoveObject(compo, False)


def update_component_version(components, version):
    """Update the ghenv.Component.Message line for a list of components."""
    new_components = []

    for comp_obj in components:
        try:
            in_code = comp_obj.Code.split("\n")
            code_length = len(in_code)
            out_code = ""

            for line_count, line in enumerate(in_code):
                stripped = line.lstrip()
                indent = line[:len(line) - len(stripped)]

                if stripped.startswith("ghenv.Component.Message"):
                    line = indent + "ghenv.Component.Message = '{}'".format(version)

                if line_count != code_length - 1:
                    out_code += line + "\n"
                else:
                    out_code += line

            comp_obj.Code = out_code

            try:
                comp_obj.Message = version
            except Exception:
                pass

            new_components.append(comp_obj)

        except Exception as e:
            print('Failed to update version in "{}": {}'.format(comp_obj.Name, e))

    return new_components


def write_py_code(gh_component, target_dir):
    """Write the component code to the repo src folder."""
    if not hasattr(gh_component, "Code"):
        return

    target_path = os.path.join(target_dir, gh_component.Name + ".py")
    with open(target_path, "wb") as f:
        f.write(gh_component.Code.encode("utf-8"))

    print("Wrote code: {}".format(target_path))


def write_ghuser(original_uo, gh_component, target_dir):
    """Update the original user object with the modified component and save it."""
    target_path = os.path.join(target_dir, gh_component.Name + ".ghuser")

    original_uo.SetDataFromObject(gh_component)
    original_uo.Path = target_path

    ok = original_uo.SaveToFile()
    if not ok:
        raise IOError("Failed to save ghuser: {}".format(target_path))

    print("Wrote ghuser: {}".format(target_path))


if _run:
    ghdoc = ghenv.Component.OnPingDocument()

    local_ghuser = r"C:\Users\gzorzeto\AppData\Roaming\Grasshopper\UserObjects\dewbee"
    repo_ghuser = r"C:\Users\gzorzeto\Documents\GitHub_repos\dewbee_main\grasshopper\user_objects"
    repo_py = r"C:\Users\gzorzeto\Documents\GitHub_repos\dewbee_main\grasshopper\src"

    preparedir(repo_ghuser)
    preparedir(repo_py)

    with NamespaceComponentsOntoCanvas("DB", local_ghuser, ghdoc) as compos:
        comp_list = [compo for compo, _, _ in compos.compos]
        update_component_version(comp_list, DEWBEE_VERSION)

        for compo, uo, source_path in compos.compos:
            write_py_code(compo, repo_py)
            write_ghuser(uo, compo, repo_ghuser)
    
    # Update local ghuser folder
    preparedir(local_ghuser)
    copy_file_tree(repo_ghuser, local_ghuser)
# ---------- end savecompos ----------
